# Grasshopper definition Shoes-gcode.ghx (Grasshopper 0.9.76)
# plug-ins: Python Interpreter, GH_CPython

# ---- group: layer_height
number_slider = Slider(0.2, range=0.1..30)

# ---- group: Margin
number_slider_2 = Slider(2, range=1..200)

# ---- group: W
number_slider_3 = Slider(4, range=0..100)

# ----
rectangle = Rectangle(Plane=PlaneXY(0, 0, 0), XSize="0 to 200", YSize="0 to 200", Radius=0)  # -> Rectangle, Length
crv = Curve(rectangle.Rectangle)

# ---- group: Back-A
srf = Surface(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)

# ---- group: Back
srf_2 = Surface(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)

# ---- group: Front-1
srf_3 = Surface(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)

# ---- group: In
srf_4 = Surface(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)

# ---- group: Front-1
srf_5 = Surface(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)

# ---- group: Out
srf_6 = Surface(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)

# ---- group: Back-B
srf_7 = Surface(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)

# ---- group: Front-2
srf_8 = Surface(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)

# ----
neg = Negative(Value=number_slider_2)
division = Division(A="24", B=number_slider_3)
addition = Addition(A=Slider(100, range=0..130), B=number_slider_2)

# ---- group: TARGET
srf_9 = Surface(srf_3)

# ----
Y = UnitY(Factor=neg)
pt = ConstructPoint(XCoordinate=Slider(20, range=0..1000), YCoordinate=Slider(20, range=0..1000), ZCoordinate=0)
addition_2 = Addition(A=addition, B=number_slider_2)
neg_2 = Negative(Value=addition_2)
Y_2 = UnitY(Factor=addition)
X = UnitX(Factor=number_slider_3)
Y_3 = UnitY(Factor=neg_2)
sdivide = DivideSurface(Surface=srf_9, UCount=Slider(60, range=0..100), VCount=Slider(42, range=0..100))  # -> Points, Normals, Parameters
preview = CustomPreview(Geometry=crv, Shader=ColourSwatch(SwatchColor=RGB(255, 255, 255)))
flip = FlipMatrix(Data=sdivide.Points)
move = Move(Geometry=pt, Motion=Y)  # -> Geometry, Transform
move_2 = Move(Geometry=pt, Motion=Y_2)  # -> Geometry, Transform
move_3 = Move(Geometry=move_2.Geometry, Motion=X)  # -> Geometry, Transform
move_4 = Move(Geometry=move_3.Geometry, Motion=Y_3)  # -> Geometry, Transform
move_5 = Move(Geometry=move_4.Geometry, Motion=X)  # -> Geometry, Transform
pline = PolyLine(Vertices=sdivide.Points, Closed=False)
pline_2 = PolyLine(Vertices=flip, Closed=False)
integer_division = IntegerDivision(A=division, B="2")
flatten = FlattenTree(Tree=pline, Path="{0}")
flatten_2 = FlattenTree(Tree=pline_2, Path="{0}")
merge = Merge(Data1=move.Geometry, Data2=move_2.Geometry, Data3=move_3.Geometry, Data4=move_4.Geometry, Data5=move_5.Geometry)
multiplication = Multiplication(A=number_slider_3, B="2")
item = ListItem(List=flatten, Index=0, Wrap=True)  # -> Item1, Item
item_2 = ListItem(List=flatten_2, Index=0, Wrap=True)  # -> Item1, Item
merge_2 = Merge(Data1=item.Item1, Data2=item_2.Item1, Data3=item.Item, Data4=item_2.Item)
dispatch = Dispatch(List=flatten, DispatchPattern=[True, False])  # -> ListA, ListB
dispatch_2 = Dispatch(List=flatten_2, DispatchPattern=[True, False])  # -> ListA, ListB
flip_2 = FlipCurve(Curve=dispatch.ListB)  # -> Curve, Flag
flip_3 = FlipCurve(Curve=dispatch_2.ListB)  # -> Curve, Flag

# ---- group: layer_count
number_slider_4 = Slider(20, range=1..350)

# ----
disc = Discontinuity(Curve=merge_2, Level="3")  # -> Points, Parameters
disc_2 = Discontinuity(Curve=dispatch.ListA, Level="3")  # -> Points, Parameters
disc_3 = Discontinuity(Curve=flip_2.Curve, Level="3")  # -> Points, Parameters
series = Series(Start=0, Step=multiplication, Count=integer_division)
disc_4 = Discontinuity(Curve=dispatch_2.ListA, Level="3")  # -> Points, Parameters
disc_5 = Discontinuity(Curve=flip_3.Curve, Level="3")  # -> Points, Parameters
viewer = ParamViewer(disc_2.Points)
pline_3 = PolyLine(Vertices=merge, Closed=False)
merge_3 = Merge(Data1=disc_2.Points, Data2=disc_3.Points)
X_2 = UnitX(Factor=series)
crv_2 = Curve(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)
panel = Panel("0.4")
merge_4 = Merge(Data1=disc_4.Points, Data2=disc_5.Points)
crv_3 = Curve(crv_2)
viewer_2 = ParamViewer(merge_3)
flatten_3 = FlattenTree(Tree=merge_3, Path="{0}")
move_6 = Move(Geometry=pline_3, Motion=X_2)  # -> Geometry, Transform
flatten_4 = FlattenTree(Tree=merge_4, Path="{0}")
offset = Offset(Curve=crv_3, Distance="-0.4", Plane=PlaneXY(0, 0, 0), Corners=1)
join = JoinCurves(Curves=move_6.Geometry, Preserve=False)
pline_4 = PolyLine(Vertices=flatten_3, Closed=False)
pline_5 = PolyLine(Vertices=flatten_4, Closed=False)
crv_4 = Curve(offset)
disc_6 = Discontinuity(Curve=crv_4, Level=1)  # -> Points, Parameters
merge_5 = Merge(Data1=pline_5, Data2=crv_4)
merge_6 = Merge(Data1=pline_4, Data2=crv_4)
number_slider_5 = Slider(0.2, range=0..1)
crv_5 = Curve(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)
crv_6 = Curve(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)
Z = UnitZ(Factor=number_slider)
merge_7 = Merge(Data1=crv_5, Data2=crv_6)

# ---- group: Back-B
crv_7 = Curve(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)
crv_8 = Curve(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)

# ---- group: Back-16
crv_9 = Curve(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)
crv_10 = Curve(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)

# ---- group: Back-A
crv_11 = Curve(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)
crv_12 = Curve(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)

# ----
move_7 = Move(Geometry=join, Motion=Z)  # -> Geometry, Transform
flatten_5 = FlattenTree(Tree=merge_7, Path="{0}")
panel_2 = Panel(merge_7)

# ---- group: In
crv_13 = Curve(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)
crv_14 = Curve(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)

# ---- group: In-32
crv_15 = Curve(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)
crv_16 = Curve(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)

# ----
lng = ListLength(List=flatten_5)

# ---- group: Out-32
crv_17 = Curve(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)
crv_18 = Curve(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)

# ----
series_2 = Series(Start=number_slider_5, Step=number_slider_5, Count=lng)

# ---- group: Front-1-32
crv_19 = Curve(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)
crv_20 = Curve(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)

# ----
Z_2 = UnitZ(Factor=series_2)

# ---- group: Front
crv_21 = Curve(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)
crv_22 = Curve(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)

# ---- group: Front-2-32
crv_23 = Curve(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)
crv_24 = Curve(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)

# ----
move_8 = Move(Geometry=merge_7, Motion=Z_2)  # -> Geometry, Transform
crv_25 = Curve(move_8.Geometry)
panel_3 = Panel(crv_25)
flatten_6 = FlattenTree(Tree=crv_25, Path="{0}")
viewer_3 = ParamViewer(flatten_6)
crv_26 = Curve(move_7.Geometry)
flatten_7 = FlattenTree(Tree=crv_26, Path="{0}")
disc_7 = Discontinuity(Curve=flatten_6, Level=Slider(1, range=0..10))  # -> Points, Parameters
explode = Explode(Curve=flatten_6, Recursive=True)  # -> Segments, Vertices

# ---- group: amp
number_slider_6 = Slider(0.1, range=0..1)

# ---- group: Speed
number_slider_7 = Slider(1000, range=1000..5000)

# ----
pt_2 = Point(explode.Vertices)
viewer_4 = ParamViewer(pt_2)
disc_8 = Discontinuity(Curve=flatten_7, Level=1)  # -> Points, Parameters
shift = ShiftList(List=disc_8.Points, Shift="1", Wrap=True)
panel_4 = Panel(disc_8.Points)
shift_2 = ShiftList(List=pt_2, Shift="1", Wrap=True)
pdecon = Deconstruct(Point=disc_8.Points)  # -> XComponent, YComponent, ZComponent
pdecon_2 = Deconstruct(Point=pt_2)  # -> XComponent, YComponent, ZComponent
dist = Distance(PointA=disc_8.Points, PointB=shift)
dist_2 = Distance(PointA=pt_2, PointB=shift_2)
num = Number(pdecon.YComponent)
num_2 = Number(pdecon.ZComponent)
num_3 = Number(pdecon.XComponent)
num_4 = Number(pdecon_2.YComponent)
num_5 = Number(pdecon_2.ZComponent)
num_6 = Number(pdecon_2.XComponent)
lng_2 = ListLength(List=num_3)  # -> flatten(Length)
rev = ReverseList(List=dist)
lng_3 = ListLength(List=num_6)  # -> flatten(Length)
rev_2 = ReverseList(List=dist_2)
flatten_8 = FlattenTree(Tree=num, Path="{0}")
flatten_9 = FlattenTree(Tree=num_2, Path="{0}")
flatten_10 = FlattenTree(Tree=num_3, Path="{0}")
flatten_11 = FlattenTree(Tree=num_4, Path="{0}")
flatten_12 = FlattenTree(Tree=num_5, Path="{0}")
flatten_13 = FlattenTree(Tree=num_6, Path="{0}")
split = SplitList(List=rev, Index="1")  # -> ListA, ListB
split_2 = SplitList(List=rev_2, Index="1")  # -> ListA, ListB
panel_5 = Panel(pt_2)
rev_3 = ReverseList(List=split.ListB)
rev_4 = ReverseList(List=split_2.ListB)
ins = InsertItems(List=rev_3, Item="0", Indices="0", Wrap=True)
item_3 = ListItem(List=flatten_12, Index="-1", Wrap=True)
item_4 = ListItem(List=flatten_11, Index="-1", Wrap=True)
item_5 = ListItem(List=flatten_13, Index="-1", Wrap=True)
ins_2 = InsertItems(List=rev_4, Item="0", Indices="0", Wrap=True)
flatten_14 = FlattenTree(Tree=ins, Path="{0}")  # -> simplify(Tree)
panel_6 = Panel(item_5)
flatten_15 = FlattenTree(Tree=ins_2, Path="{0}")  # -> simplify(Tree)
viewer_5 = ParamViewer(flatten_14)
viewer_6 = ParamViewer(flatten_13)
multiplication_2 = Multiplication(A=flatten_14, B=number_slider_6)
panel_7 = Panel(lng_2)
multiplication_3 = Multiplication(A=flatten_15, B=number_slider_6)
panel_8 = Panel(lng_3)
python = PythonScript(x=flatten_10, y=flatten_8, z=flatten_9, e=multiplication_2, u=lng_2, speed=number_slider_7)  # -> out, a; inputs x: list, y: list, z: list, e: list, u: list
# ---------- python: Python ----------
_start = 0
_end = 0

gcode = []


gcode.append("; Skirt")
gcode.append("G1 Z30" + " F" + str(speed))


for i in xrange(len(u)):
    _end += u[i]
    extrude = 0
   

    se = "; layer " + str(i)# + ", " + str(_start) + "-" + str(_end)
    gcode.append(se)
    
    for j in xrange(_start, _end):
        extrude += float(e[j])
        z_tmp = float(z[0]) + 30
        text = "G1 X" + str(x[j]) + " Y" + str(y[j]) + " Z" + str(z[j]) + " E" + str(extrude)
        gcode.append(text)

    gcode.append("G1 Z " + str(z_tmp))
    gcode.append("G92 E0")
    #print(_start, _end)
    _start = _end + 1

    
a = gcode
# ---------- end python ----------
item_6 = ListItem(List=multiplication_3, Index="-1", Wrap=True)
panel_9 = Panel(multiplication_3)
python_2 = PythonScript(x=flatten_13, y=flatten_11, z=flatten_12, e=multiplication_3, u=lng_3, speed=number_slider_7)  # -> out, a; inputs x: list, y: list, z: list, e: list, u: list
# ---------- python_2: Python ----------
_start = 0
_end = 0

x.append(120.0)
y.append(120.0)
z.append(125.0)
e.append(120.0)


gcode = []


gcode.append("; Body")
gcode.append("G1 Z30" + " F" + str(speed))


for i in xrange(len(u)):
    _end += u[i]


    se = "; layer " + str(i) + ": " + str(_start) + "-" + str(_end)
    gcode.append(se)
    extrude = 0
    
    for j in xrange(_start, _end):
        extrude += float(e[j])
        z_tmp = float(z[_end]) + 5
        text = "G1 X" + str(x[j]) + " Y" + str(y[j]) + " Z" + str(z[j]) + " E" + str(extrude)
        gcode.append(text)

    gcode.append("G1 Z " + str(z_tmp))
    gcode.append("G92 E0")
    _start = _end

    
a = gcode
# ---------- end python_2 ----------
panel_10 = Panel(item_6)
panel_11 = Panel(python.a)
multiplication_4 = Multiplication(A=number_slider_4, B="2")
panel_12 = Panel(""";Shoes-Kint
G90
M82
M106 S0
M104 S190 T0
M109 S190 T0""")
panel_13 = Panel(python_2.a)
txt = Text(python.a)
txt_2 = Text(python_2.a)
list = ValueList({"txt": 1, "gcode": 2}, selected="gcode")

# ---- group: file_name
panel_14 = Panel("190527-Front")

# ----
button = Button()
export_gcode_component = GH_CPython(
    PATH="C:\Users\yoshioca\Desktop\",
    File_Name=panel_14,
    File_Type=list,
    layer_height=number_slider,
    layer_count=multiplication_4,
    extrude_amp=number_slider_6,
    HEADER=panel_12,
    SKIRT=txt,
    MSG=txt_2,
    TF=button)  # -> a, debug; inputs PATH: list, File_Name: list, File_Type: list, layer_height: list, layer_count: list, extrude_amp: list, HEADER: list, SKIRT: list, MSG: list, TF: list
# ---------- export_gcode_component: Python ----------
from datetime import datetime

def TYPE(num):
    if num == 1:
        type = ".txt"
    elif num == 2:
        type = ".gcode"
    return type


debug = []
comment = []

path_set = str(PATH)
file_name = str(File_Name)
file_type = TYPE(File_Type)
 


# HEADER gode
for i in xrange(len(HEADER)):
    debug.append(HEADER[i])
    debug.append("\n")

debug.append("\n")



# Skirt gode
for i in xrange(len(SKIRT)):
    debug.append(SKIRT[i])
    debug.append("\n")

debug.append("\n")


# Body gcode
for i in xrange(len(MSG)):
    debug.append(MSG[i])
    if i < len(MSG)-1:
        debug.append("\n")


path_out = path_set + "\\" + file_name + file_type

a = path_out

len = len(debug)

# for i in xrange(len):
#     print(debug[i])





if TF:
    now = "; Export Time - " + str(datetime.now().strftime("%Y/%m/%d %H:%M:%S"))
    comment.append(now)
    comment.append("\n")

    height = "; Layer Height(mm) - " + str(layer_height)
    comment.append(height)
    comment.append("\n")

    count = "; Layer Count - " + str(layer_count)
    comment.append(count)
    comment.append("\n")


    amp = "; Extrude Amp - " + str(extrude_amp)
    comment.append(amp)
    comment.append("\n")
    comment.append("\n")

    f = open(path_out, "w")
    f.writelines(comment)
    f.writelines(debug)
    f.close
# ---------- end export_gcode_component ----------
panel_15 = Panel(button)
panel_16 = Panel(export_gcode_component.a)
panel_17 = Panel(export_gcode_component.debug)
